# Grasshopper definition Sawfish_example_14_04_2023.gh (Grasshopper 1.0.7)
# plug-ins: cHRC, ShapeDiverForGrasshopper, Human, Kangaroo2 Components

sddp = ShapeDiverDocumentPayload({AbsoluteTolerance=0, AngleTolerance=0, DistanceDisplayPrecision=0, GltfVersion="Gltf2", InputGroups="{}", OutputGroups="{}", RelativeTolerance=0, UnitSystem=0, VersionCreated="1.13.1.0", VersionSaved="1.13.1.0"})
srf = Surface(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)
sddp_2 = ShapeDiverDocumentPayload({AbsoluteTolerance=0, AngleTolerance=0, DistanceDisplayPrecision=0, GltfVersion="Gltf2", InputGroups="{}", OutputGroups="{}", RelativeTolerance=0, UnitSystem=0, VersionCreated="1.13.1.0", VersionSaved="1.13.1.0"})
srf_2 = Surface(srf)
# SAWFISH please read
# Sawfish, because it creates, based on complex triangulated shapes, solid beam and plate geometry with planar sides, which can be sawn using saw as tool only.
# 
# Sawfish, because this Plugin is about creating solid beam and plate geometry, with planar and where possible parallel sides which allows to cut the geometry
# very efficiently by a CNC-Machine with a saw as tool or by a circular handsaw. The plugin is basically the result of my own way, firstly as as BFH AHB applied
# science university student and later on as BFH AHB employee, to find solutions to build every complex and triangulated shape in wood. The journey has begun
#  2014 as an architecture student and is an ongoing process; find more about on my website www.miro.vision. Therefore, Sawfish is a permanent and ongoing
# project, a work in progress (WIP); take it as it is:) I`m aware that there might be many other different and maybe smarter ways to achieve similar results; I see
# Sawfish more as my own autodidactic journey of exploring the digital world and possibilities combined with my background as carpenter and architect.
# Have fun to test it as it is, an example file and a YouTube tutorial might follow as soon as I find time; Support: Not guaranteed ... One more thing: If you do
# a project of any kind with this plugin I’m happy to get some images of it, find my contact on my website under about:)!  Installation: Copy in your libraries folder,
#  try to unblock in properties, it might just work with the latest version of Rhino 7 Windows.
# 
# 
# WIP Version 071, Installation: Copy in your libraries folder, try to unblock in properties, it might just work with the latest version of Windows Rhino 7.
# 
# License: GNU LGPLv3
# 
# Miro Bannwart, www.miro.vision
# PS:
# 
# Basically its all about to solve the node in case of planar (possible to cut by a saw) sides.
# If the sides have to be planar, in case of more than 3 different Planes/Plates/Beams meeting
# at one node, the node has to be cut out on one of the two sides of the  material
# to avoid intersections. The plugin is mainly about how this out-cut looks... most of it is WIP take it as it is...:)
# This example Files covers most of the plugin but not everything;
# Tutorials, more examples and more describtion might follow if I find time....
# 
# AND: CHECK YOUR GEOMETRY,  ANGLES ETC. BEFORE FABRICATION:
# CHECK ON YOUR OWN IF ITS CORRECT!!
# 
# Best,
# 
# Miro
# Input
srf_3 = Surface(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)
srf_4 = Surface(srf_2)
Y = UnitY(Factor=Slider(11160, range=0..100000))
line = Line([Line((46501.26315, 6899.709835, 0), (46605.54058, 7779.325919, 0)), Line((47103.46501, 7673.263489, 0), (47123.02256, 6599.785254, 0)), Line((47831.0167, 6521.195484, 0), (48764.6752, 6695.085927, 0)), Line((47689.56945, 7129.458532, 0), (47461.88955, 8027.168826, 0)), Line((48253.02029, 7570.617707, 0), (48626.06345, 7433.326983, 0)), Line((49099.57415, 7618.936504, 0), (49104.57228, 8907.023706, 0)), Line((49790.60838, 8183.62942, 0), (49726.13019, 7155.183282, 0)), Line((47099.63868, 8275.155509, 0), (47444.27405, 8395.913435, 0)), Line((48752.41336, 9218.36101, 0), (47932.00285, 9357.584561, 0))])
line_2 = Line([Line((45884.43615, 2624.155485, 0), (46193.12523, 4337.309371, 0)), Line((48049.33588, 4081.227007, 0), (48058.58699, 2803.276407, 0)), Line((46725.96087, 3300.669901, 0), (47121.78443, 3427.538617, 0)), Line((49001.90487, 3490.739417, 0), (49134.87144, 4550.102069, 0)), Line((49505.37138, 3307.134658, 0), (49611.59706, 4706.467659, 0)), Line((45513.99095, 3408.750979, 0), (45775.92646, 4785.955168, 0)), Line((47789.96565, 4836.173252, 0), (48567.80901, 5083.732478, 0)), Line((46333.6915, 2526.615718, 0), (46312.47324, 3092.362749, 0)), Line((49249.60836, 2458.125317, 0), (49739.14135, 2557.794908, 0))])
srf_5 = Surface(srf_2)
move = Move(Geometry=srf_4, Motion=Y)  # -> Geometry, Transform
crv_all_plates = Curve([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])
entwine = Entwine(Branch00=line_2, Branch01=line, FlattenInputs=True)

# ----
# Design Surface
# Scale to tpi
# possible size
# The WIP tpi node
# is far from finished.
# It needs a specific input
# size otherwise its not working...
cluster = Cluster_3(srf=srf_5)  # -> srf_scaled_2, num_scale_back_factor_2

crv = Curve(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)
mesh_eule_high_res = Mesh(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)
crv_2 = Curve([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])
crv_3 = Curve(flatten(entwine))
crv_hex_and_triangles = Curve([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])
crv_4 = Curve(entwine)
# Differential growth on mesh
divide = DivideCurve(Curve=crv, Count=10, Kinks=False)  # -> Points, Tangents, Parameters
srf_input = Surface(srf_3)
flipic = _02_FlipInputCurves(InputCurves=crv_2, DivisionFactor=0.03, MinimumDivisionCount=3, MaximumDivisioCount=4, NurbsDegree=3, KnotStyle=1)  # -> Points, FlippedInputCurves
crv_5 = Curve(crv_4)
# Sort and flip Curves
curvepoint = PointOnCurve(crv_4, parameter=0.5)
srf_6 = Surface(move.Geometry)
crv_all_plates_2 = Curve(crv_all_plates)
# 0 Triangulation
divide_surface_tri = DivideSurfaceTri(Surface=srf_input, U=Slider(8, range=0..10), V=Slider(8, range=0..10))
c_this_one = Curves([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])
meshcp = MeshClosestPoint(Point=divide.Points, Mesh=mesh_eule_high_res)  # -> Point, Index, Parameter
end = EndPoints(Curve=crv_5)  # -> Start, End
replace = ReplaceItems(List=crv_hex_and_triangles, Indices=Slider(40, range=0..100), Wrap=False)

# ----
# Design Surface
# Scale to tpi
# possible size
# The WIP tpi node
# is far from finished.
# It needs a specific input
# size otherwise its not working...
cluster_2 = Cluster_3(srf=srf_6)  # -> srf_scaled_2, num_scale_back_factor_2

srf_scaled = Surface(cluster.srf_scaled_2)
preview = CustomPreview(Geometry=mesh_eule_high_res, Material=ColourSwatch(SwatchColor=RGBA(255, 255, 255, 60)))
num_scale_back_factor = Number(cluster.num_scale_back_factor_2)
srtcrv = SortCurves(
    CurvesTr=crv_5,
    AutoManIter=1,
    Iterations=4,
    DivisionFactor=Slider(0, range=0..1),
    MinDivision=Slider(1, range=0..1),
    IndexOneCurve=0)  # -> OPoints, OPointsOneCurve
loft = Loft(Curves=c_this_one, Options={Adjust=False, Closed=False, LoftEnds=0, LoftSimp=0, LoftType=0, Rebuild=10, Refit=0.01})
crv_tri = Curve(divide_surface_tri)
nke = _04_NakedEdges(Polylines=crv_all_plates_2, CheckDist=0.01)
points = PointList(Points=curvepoint, Size=Slider(169, range=0..1000))
preview_2 = CustomPreview(Geometry=end.Start, Material=ColourSwatch(SwatchColor=RGB(107, 107, 107)))
srf_7 = Surface(loft)
pt = Point(srtcrv.OPoints)
dyntri = _03_Dynamictriangulate(
    InputCurves=flipic.FlippedInputCurves,
    DivisionFactor=Slider(0.134, range=0..1),
    MinimumDivisionAtStart=Slider(0, range=0..10),
    MaximumDivisionAtStart=Slider(2, range=0..10),
    MinimumDivision=Slider(3, range=0..10),
    MaximumDivision=Slider(8, range=0..10))  # -> ZigZagPolylines, TrianglePolylines
sddp_3 = ShapeDiverDocumentPayload({AbsoluteTolerance=0, AngleTolerance=0, DistanceDisplayPrecision=0, GltfVersion="Gltf2", InputGroups="{}", OutputGroups="{}", RelativeTolerance=0, UnitSystem=0, VersionCreated="1.13.1.0", VersionSaved="1.13.1.0"})
crv_naked = Curve(nke)
clean = CleanTree(RemoveNulls=Toggle(True), RemoveInvalid=True, RemoveEmpty=False, Tree=replace)
# Everything is as well on github ;) here  https://github.com/mirobannwart/Sawfish
c_this_one_2 = Curves([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])
dif_grw = _05_Dif_growth_on_mesh(
    Starting_Points=meshcp.Point,
    Max_Centers=158,
    Mesh=mesh_eule_high_res,
    Radius=Slider(72, range=0..1000),
    OnMesh=True,
    MaxIterations=Slider(200, range=0..1000))
srf_8 = Surface(srf_scaled)
# especially WIP / far from finished/ take it as is.. agent based growing tpi (tangential plane intersection) plates towards similar edge lengths SILENT INTERNAL SOLVER
# Input values could be galapagos optimized
srf_scaled_2 = Surface(cluster_2.srf_scaled_2)
pt_2 = Point(Point(7604.051039, -2815.159521, 2740.516341))
num_scale_back_factor_2 = Number(cluster_2.num_scale_back_factor_2)
loft_2 = Loft(Curves=c_this_one_2, Options={Adjust=False, Closed=False, LoftEnds=0, LoftSimp=0, LoftType=0, Rebuild=10, Refit=0.01})
pline = PolyLine(Vertices=dif_grw, Closed=False)
crv_6 = Curve(flatten(clean))
# Enforcement Beam top
crv_tri_2 = Curve(crv_tri)
pline_2 = PolyLine(Vertices=pt, Closed=False)
srf_9 = Surface(loft_2)
# Beam top
crv_tri_3 = Curve(crv_tri)
preview_3 = CustomPreview(Geometry=pline, Material=ColourSwatch(SwatchColor=RGB(0, 0, 0)))
# especially WIP / far from finished/ take it as is.. agent based growing tpi (tangential plane intersection) plates towards similar edge lengths
area = Area(Geometry=srf_8)  # -> Area, Centroid
crv_7 = Curve(pline_2)
uniplntoclp = _03_UnifyPolylineNormalToClosestPoint(Polylines=dyntri.TrianglePolylines, FlipPoints=pt_2)
enforcetop = EnforceTop(
    Polylines=crv_tri_2,
    Width=58,
    Lenght=200,
    NodeCutPos=Toggle(True),
    BackDist=Slider(30, range=0..100),
    OffsetDirection=True,
    OffsetTol=0,
    StartIteration=-1,
    MaxIterations=-1)  # disabled
offsettop_chrc = OffsetTopCHRC(Polylines=crv_tri_3, OffsetLength=58, IntersectTolerance=0, OffsetDirection=True, StartIteration=-1, MaxIterations=-1)  # -> OffsetBeamPolyline, OffsetPolyline
num_thickness_plate = Number(Slider(27, range=0..100))
flip = FlipCurve(Curve=crv_6)  # -> Curve, Flag
srf_10 = Surface(srf_scaled_2)
pt_3 = Point(area.Centroid)
preview_4 = CustomPreview(Geometry=crv_7, Material=ColourSwatch(SwatchColor=RGB(0, 0, 0)))
crv_beam_enforce_top = Curve(enforcetop)
crv_8 = Curve(flip.Curve)
srf_cp = SurfaceClosestPoint(Point=pt_3, Surface=srf_8)  # -> Point, UVPoint, Distance
nke_2 = _05_NakedEdges(Polylines=crv_6, CheckDist=0.01)  # -> flatten(NakedEdges)
crv_beam_top = Curve(offsettop_chrc.OffsetBeamPolyline)
# 1 Beam Top Polyline
nke_3 = _05_NakedEdges(Polylines=crv_tri_3, CheckDist=0.01)
# especially WIP Hexagons and Triangles combined
offsettop_chrc_2 = _02OffsetTopCHRC(
    Polylines=crv_8,
    OffsetLength=Slider(45, range=0..100),
    IntersectTolerance=0,
    OffsetDirection=True,
    StartIteration=-1,
    MaxIterations=-1)  # -> OffsetBeamPolyline, OffsetPolyline
area_2 = Area(Geometry=srf_10)  # -> Area, Centroid
crv_tri_polyline = Curve(uniplntoclp)
evalsrf = EvaluateSurface(Surface=srf_8, Point=srf_cp.UVPoint)  # -> Point, Normal, UDirection, VDirection, Frame
# a1, a2, b1, b2, value mapping
# 
# mapping shortest edge lenghts as a
# strenght factor of the towards shortest
# edge vector
# 
# a1, estimated minimal edge-lenght
# a2, estimated max edge- lenght
# 
# b1, map target domain min
# b2, map target domain max
number_slider = Slider(25, range=0..100)
pt_4 = Point(area_2.Centroid)
polynormv = _01_PolylineNormalvector(Polylines=crv_tri_polyline, Amplitude=Slider(528, range=0..1000))  # -> PolylineCenters, NormalVectors

crv_9 = Curve(crv_8)
crv_10 = Curve(offsettop_chrc_2.OffsetBeamPolyline)
crv_11 = Curve(crv_9)

circle = CircleCNR(Center=srf_cp.Point, Normal=evalsrf.Normal, Radius=Slider(2, range=0..10))
srf_cp_2 = SurfaceClosestPoint(Point=pt_4, Surface=srf_10)  # -> Point, UVPoint, Distance
num_thickness_beam = Number(Slider(40, range=0..100))
vdisex = VectorDisplayEx(Point=polynormv.PolylineCenters, Vector=polynormv.NormalVectors, Colour=RGB(0, 0, 0), Width=2)
top = ValueList({"Closed": 1, "Open": 0}, selected="Open")
num_thickness_plate_2 = Number(num_thickness_plate)
# Beam offset
crv_beam_top_2 = Curve(crv_beam_top)

# ---- group: Galapagos optimised 1
number_slider_2 = Slider(50, range=0..100)
number_slider_3 = Slider(0.3, range=0..1)
number_slider_4 = Slider(100, range=0..100)
number_slider_5 = Slider(64, range=50..100)
number_slider_6 = Slider(0.46, range=0..1)
number_slider_7 = Slider(0.44, range=0..1)
number_slider_8 = Slider(43, range=0..100)
number_slider_9 = Slider(37, range=0..100)
number_slider_10 = Slider(316, range=0..400)

# ----
divide_2 = DivideCurve(Curve=circle, Count=number_slider, Kinks=False)  # -> Points, Tangents, Parameters
evalsrf_2 = EvaluateSurface(Surface=srf_10, Point=srf_cp_2.UVPoint)  # -> Point, Normal, UDirection, VDirection, Frame
duppt = RemoveDuplicatePts(Points=divide_2.Points, Tolerance=0.01)
crv_12 = Curve(nke_2)
number_slider_11 = Slider(70, range=0..100)
bool = Boolean(Toggle(False))
bool_2 = Boolean(Toggle(True))
num_thickness_plate_3 = Number(num_thickness_plate)
# BEAMS AND PLATES FOR HANDSAW FABRICATION / ANGLE VISUALISATION
# First tries, take it as it is
# Plate
crv_tri_4 = Curve(crv_tri)
srf_cp_3 = SurfaceClosestPoint(Point=duppt, Surface=srf_8)  # -> Point, UVPoint, Distance
num_thickness_enforcement_beam = Number(Slider(40, range=0..100))
circle_2 = CircleCNR(Center=srf_cp_2.Point, Normal=evalsrf_2.Normal, Radius=Slider(2, range=0..10))
crv_tri_polyline_2 = Curve(crv_tri_polyline)
num_thickness_plate_4 = Number(num_thickness_plate)
crv_beam_enforce_top_2 = Curve(crv_beam_enforce_top)
crv_tri_polyline_3 = Curve(crv_tri_polyline)
# 2 Offset Geometry
flip_2 = FlipCurve(Curve=crv_tri_4)  # -> Curve, Flag
nke_4 = _05_NakedEdges(Polylines=crv_tri_polyline_2, CheckDist=0.01)
divide_3 = DivideCurve(Curve=circle_2, Count=Slider(25, range=0..100), Kinks=False)  # -> Points, Tangents, Parameters

# ---- group: galapagos optimized 2
number_slider_12 = Slider(50, range=0..100)
number_slider_13 = Slider(0.3, range=0..1)
number_slider_14 = Slider(0.37, range=0..1)
number_slider_15 = Slider(0.75, range=0..1)
number_slider_16 = Slider(32, range=0..100)
number_slider_17 = Slider(26, range=0..100)
number_slider_18 = Slider(221, range=0..400)
number_slider_19 = Slider(96, range=0..100)
number_slider_20 = Slider(63, range=50..100)

# ----
solid_beam = SolidBeam(
    Polylines=crv_beam_top_2,
    Thickness=num_thickness_beam,
    OffsetBeam=num_thickness_plate_2,
    NodeBack=60,
    OpenCloseTop=top,
    ForcePlanarity=Toggle(True),
    CalcLines=True,
    CalcMesh=Toggle(True),
    CheckDist=0.01,
    StartIteration=-1,
    MaxIterations=-1)  # -> TopPolyline, Lowerpolyline, SideCurves, Meshes
pt_cp = Point(srf_cp_3.Point)

# ----
# Start here
button = Button()
timer = Timer(Interval=20, TimerInterval=20, Target=tpi)  # disabled

offsettop_chrc_3 = _02OffsetTopCHRC(
    Polylines=crv_tri_polyline_3,
    OffsetLength=58,
    IntersectTolerance=0,
    OffsetDirection=True,
    StartIteration=-1,
    MaxIterations=-1)  # -> OffsetBeamPolyline, OffsetPolyline
_05_off_dif_poly_hex3_s = _05_0ffset_dif_polygon_AD_3_hex_super(
    Polylines=crv_11,
    Thickness=Slider(55, range=0..100),
    NodeBackLow=Slider(68, range=0..100),
    CheckDist=0.01,
    AngleEffect=Slider(0.15, range=0..1),
    ThresholdAngle=Slider(20, range=0..1000),
    AdjustFindpointsFactor=0.35,
    CheckStepsNodeback=Slider(500, range=0..1000),
    ApproxMaxTopAngle=140,
    NakedEdge=crv_12,
    Apply_Plane_intersction_node_Middle=bool_2,
    Apply_Plane_intersction_node_Edge=bool,
    CheckAngle=0.07,
    EdgeNodeBackFactor=Slider(0.3, range=0..1))
trisimp = _03_Triangular_Plates_Simple(
    Polylines=crv_tri_4,
    Thickness=num_thickness_plate_3,
    NodeBackLow=number_slider_11,
    CheckDist=0.01,
    CheckStepsNodeback=50)

# ----
# Old Variant, more options
# but creating errors
# at tight angles
triplate = _00_TriangularPlates(
    Polylines=crv_tri_4,
    Thickness=27,
    NodeBackTop=0,
    NodeBackLow=number_slider_11,
    ForcePlanarity=True,
    CalcLines=True,
    CalcMesh=False,
    CheckDist=0.01,
    StartIteration=-1,
    MaxIterations=-1)  # -> TopPolyline, Lowerpolyline, SideCurves, Meshes; disabled

duppt_2 = RemoveDuplicatePts(Points=divide_3.Points, Tolerance=0.01)
crv_naked_edges = Curve(nke_4)
enforcementbeam = EnforcementBeam(
    Polylines=crv_beam_enforce_top_2,
    Thickness=num_thickness_enforcement_beam,
    OffsetBeam=num_thickness_plate_4,
    CalcLines=True,
    CalcMesh=False,
    CheckDist=0.01,
    StartIteration=-1,
    MaxIterations=-1)  # -> TopPolyline, Lowerpolyline, SideCurves, Meshes; disabled
pt_5 = Point(pt_cp)
# Create Triangles and Beams and snap to ground
crv_beam_top_polyline = Curve(offsettop_chrc_3.OffsetBeamPolyline)
crv_lowerpolyline_beam = Curve(solid_beam.Lowerpolyline)
crv_toppolyline_beam = Curve(solid_beam.TopPolyline)
srf_cp_4 = SurfaceClosestPoint(Point=duppt_2, Surface=srf_10)  # -> Point, UVPoint, Distance
crv_13 = Curve(_05_off_dif_poly_hex3_s)
toplowsrf = _08_TopLowSurface(SideLines=trisimp, TopLowSrfTol=0.001)  # -> TopSurface, LowerSurface, TopPolyline, LowPolyline
crv_toppolyline_plate = Curve(flatten(toplowsrf.TopPolyline))
crv_sidecurves_plate = Curve(trisimp)
crv_sidecurves_beam = Curve(solid_beam.SideCurves)

# ----
# Let it grow
let_it_grow = Slider(40, range=0..100)

crv_toppolyline_beam_e = Curve(enforcementbeam.TopPolyline)
crv_lowerpolylineplate_beam_e = Curve(enforcementbeam.Lowerpolyline)
crv_lowerpolylineplate = Curve(toplowsrf.LowPolyline)
crv_sidecurves_beam_e = Curve(enforcementbeam.SideCurves)

# ----
# before index: Speed iWeightDistribution but zero optimization
# 
# after index: iWeightDistribution2 and iWeightToShortestEdgeGlobal,
# iWeightTowardsLongest
ivelocitydecreaseatiteration = Slider(160, range=0..100000)
iweightdistribution2 = Slider(0.6, range=0..2)
num = Number(iweightdistribution2)
num_2 = Number(ivelocitydecreaseatiteration)

galapagos = Galapagos(
    fitness=num_maximize,
    gene=[nodeback, estimated_top_triangle_inside_angle, triangle_neighbour_normal_angel_effect, triangle_inside_angle_effect, threshold_applying_inside_angle_effect, accuracy_checksteps_at_node, threshold_applying_normal_angle_effect])
# Record ans save and sort
# galapagos Variants
threshold_to_record = Slider(33497, range=0..100000)
pt_cp_2 = Point(srf_cp_4.Point)
number_slider_21 = Slider(70, range=0..100)

ioutsidetolerance = Slider(0.16, range=0..10)
iaddedgepolygon = BooleanToggle(True)
num_3 = Number(ioutsidetolerance)
bool_3 = Boolean(iaddedgepolygon)

# ----
# lower than amount of initial start points
itest = Slider(0, range=0..400)

iradius = Slider(0.9, range=0..10)
# Change weights at iteartion
imaxcentercount = Panel("158")
moreagentsatlessc = BooleanToggle(False)
istopaddagents = BooleanToggle(False)
pt_6 = Point(pt_cp_2)
# Finding optimal values with galapagos for Off-Dif-P-AD_4
# Target: Small node out-cuts but no invalid combinations
# and creating beams based on offset sidlines of triangles
values = ValueList({"from Sliders": 0, "from Galapagos variants": 1}, selected="from Galapagos variants")
select_galapagos_variants = Slider(0, range=0..315)
thickness = Slider(50, range=0..100)
nodeback = Slider(60, range=50..100)
triangle_inside_angle_effect = Slider(0.34, range=0..1)
accuracy_checksteps_at_node = Slider(360, range=60..400)
estimated_top_triangle_inside_angle = Slider(64, range=30..180)
find_neighbour_check_distance = Slider(0.3, range=0..1)
triangle_neighbour_normal_angel_effect = Slider(0.99, range=0..1)
threshold_applying_inside_angle_effect = Slider(39, range=0..100)
threshold_applying_normal_angle_effect = Slider(13, range=0..100)
crv_naked_edges_2 = Curve(crv_naked_edges)
num_iweighttoshortestedgeglobal = Number("0.04")
preview_5 = CustomPreview(
    Geometry=[crv_toppolyline_beam_e, crv_lowerpolylineplate_beam_e, crv_sidecurves_beam_e],
    Material=ColourSwatch(SwatchColor=RGB(0, 0, 0)))
crv_beam_top_polyline_2 = Curve(crv_beam_top_polyline)

a2 = Slider(0.6, range=0..1)
b1 = Slider(1.2, range=0..2)
a1 = Slider(0, range=0..1)
b2 = Slider(0.8, range=0..2)

num_iweighttowardslongest = Number("0.012")
crv_tri_polyline_4 = Curve(crv_tri_polyline)
closed_brep = ClosedBrep(SideCurves=crv_sidecurves_beam, SideJoinTol=0.001, TopLowCapTol=0.001)  # -> ColsedBrep, TopSurface
num_iweightdistribution = Number("2.0")
crv_14 = Curve(crv_13)
num_iradius = Number(iradius)
crv_naked_edges_3 = Curve(crv_naked_edges)

# ----
# before index: Speed iWeightDistribution but zero optimization
# 
# after index: iWeightDistribution2 and iWeightToShortestEdgeGlobal,
# iWeightTowardsLongest
ivelocitydecreaseatiteration_2 = Slider(160, range=0..100000)
iweightdistribution2_2 = Slider(0.6, range=0..2)
num_4 = Number(ivelocitydecreaseatiteration_2)
num_5 = Number(iweightdistribution2_2)

srf_11 = Surface(srf_8)
num_6 = Number(itest)
bool_4 = Boolean(istopaddagents)
pt_7 = Point(pt_5)
num_7 = Number(imaxcentercount)
bool_5 = Boolean(moreagentsatlessc)
bool_6 = Boolean(button)
closed_brep_2 = ClosedBrep(SideCurves=crv_sidecurves_beam_e, SideJoinTol=0.001, TopLowCapTol=0.001)  # -> ColsedBrep, TopSurface

ioutsidetolerance_2 = Slider(0.16, range=0..10)
iaddedgepolygon_2 = BooleanToggle(True)
num_8 = Number(ioutsidetolerance_2)
bool_7 = Boolean(iaddedgepolygon_2)

closed_brep_3 = ClosedBrep(SideCurves=crv_sidecurves_plate, SideJoinTol=0.001, TopLowCapTol=0.001)  # -> ColsedBrep, TopSurface
closed_brep_4 = _07_ClosedBrep(SideLines=crv_14, SideJoinTol=0.001, TopLowCapTol=0.001)  # -> ColsedBrep, SideSurfaces
off_dif_p_ad_4 = _05_Offset_Different_Polygons_Angle_Dependent_4(
    Polylines=crv_tri_polyline_4,
    Thickness=number_slider_21,
    NodeBackLow=Slider(80, range=0..100),
    CheckDist=0.01,
    AngleEffect=1,
    AngleNormalEffect=0.4,
    ThresholdAngle=45,
    ThresholdNormalAngle=45,
    AdjustFindpointsFactor=0.35,
    CheckStepsNodeback=50,
    ApproxMaxTopAngle=140,
    NakedEdge=crv_naked_edges_2)

# ----
# lower than amount of initial start points
itest_2 = Slider(0, range=0..400)

iradius_2 = Slider(0.9, range=0..10)
# Change weights at iteartion
imaxcentercount_2 = Panel("158")
off_dif_p_ad_4_2 = _05_Offset_Different_Polygons_Angle_Dependent_4(
    Polylines=crv_beam_top_polyline_2,
    Thickness=number_slider_21,
    NodeBackLow=Slider(50, range=0..100),
    CheckDist=0.01,
    AngleEffect=1,
    AngleNormalEffect=0.4,
    ThresholdAngle=45,
    ThresholdNormalAngle=45,
    AdjustFindpointsFactor=0.35,
    CheckStepsNodeback=50,
    ApproxMaxTopAngle=140,
    NakedEdge=crv_naked_edges_3)
moreagentsatlessc_2 = BooleanToggle(False)
istopaddagents_2 = BooleanToggle(False)
num_slider_or_galapagos = Number(values)
num_select_galapagos_variants = Number(select_galapagos_variants)
crv_all_plates_3 = Curve(crv_all_plates_2)
crv_sidecurves_plates = Curve(simplify(off_dif_p_ad_4))
num_iweighttoshortestedgeglobal_2 = Number("0.04")
brep = Brep(closed_brep_4.ColsedBrep)
brep_2 = Brep(closed_brep_3.ColsedBrep)
crv_sidecurves_beams = Curve(simplify(off_dif_p_ad_4_2))
srf_12 = Surface(closed_brep_3.TopSurface)
srf_13 = Surface()
srf_14 = Surface()
srf_15 = Surface(closed_brep.TopSurface)
brep_3 = Brep(closed_brep.ColsedBrep)

b1_2 = Slider(1.2, range=0..2)
a2_2 = Slider(0.6, range=0..1)
a1_2 = Slider(0, range=0..1)
b2_2 = Slider(0.8, range=0..2)

num_iweighttowardslongest_2 = Number("0.012")
brep_4 = Brep(closed_brep_2.ColsedBrep)
srf_16 = Surface(closed_brep_2.TopSurface)
num_iweightdistribution_2 = Number("2.0")
num_internal_iterations = Number(let_it_grow)
edges = BrepEdges(Brep=brep_3)  # -> Naked, Interior, NonManifold
merge = Merge(
    Data1=thickness,
    Data2=nodeback,
    Data3=find_neighbour_check_distance,
    Data4=triangle_inside_angle_effect,
    Data5=triangle_neighbour_normal_angel_effect,
    Data6=threshold_applying_inside_angle_effect,
    Data7=threshold_applying_normal_angle_effect,
    Data8=accuracy_checksteps_at_node,
    Data9=estimated_top_triangle_inside_angle)  # -> flatten(Result)
# CLOSED BREP
edges_2 = BrepEdges(Brep=brep_2)  # -> Naked, Interior, NonManifold
edges_3 = BrepEdges(Brep=brep_4)  # -> Naked, Interior, NonManifold
num_iradius_2 = Number(iradius_2)
srf_17 = Surface(srf_10)
num_9 = Number(itest_2)
pt_8 = Point(pt_6)
num_10 = Number(imaxcentercount_2)
bool_8 = Boolean(moreagentsatlessc_2)
bool_9 = Boolean(istopaddagents_2)
data = Data(flatten([33501, 50, 66, 0.3, 0.43, 0.63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]))
closed_brep_5 = _07_ClosedBrep(SideLines=crv_sidecurves_beams, SideJoinTol=0.001, TopLowCapTol=0.001)  # -> ColsedBrep, SideSurfaces
num_sliders = Number(merge)
num_sliders_2 = Number(num_sliders)
num_scale_back_factor_3 = Number(num_scale_back_factor)
crv_tri_polyline_5 = Curve(crv_tri_polyline_4)
brep_5 = Brep(closed_brep_5.ColsedBrep)
preview_6 = CustomPreview(Geometry=srf_12, Material=ColourSwatch(SwatchColor=RGBA(255, 255, 255, 98)))
preview_7 = CustomPreview(Geometry=srf_13, Material=ColourSwatch(SwatchColor=RGBA(0, 0, 0, 44)))
preview_8 = CustomPreview(Geometry=srf_14, Material=ColourSwatch(SwatchColor=RGBA(0, 38, 255, 98)))
preview_9 = CustomPreview(Geometry=srf_15, Material=ColourSwatch(SwatchColor=RGBA(255, 255, 255, 98)))
bfps = Beam_from_Plate_SideLines(
    Polylines=crv_tri_polyline_5,
    OffsetLength=58,
    IntersectTolerance=0,
    OffsetDirection=True,
    SideLines=crv_sidecurves_plates)  # -> OffsetBeamPolyline, OffsetPolyline, BeamSideLines
debrep = DeconstructBrep(Brep=brep)  # -> flatten(Faces), Edges, Vertices
preview_10 = CustomPreview(Geometry=brep_4, Material=ColourSwatch(SwatchColor=RGB(0, 89, 255)))
preview_11 = CustomPreview(Geometry=srf_16, Material=ColourSwatch(SwatchColor=RGBA(255, 255, 255, 98)))
preview_12 = CustomPreview(Geometry=brep_5, Material=ColourSwatch(SwatchColor=RGBA(255, 255, 255, 56)))
crv_sidecurves = Curve(simplify(crv_sidecurves_plates))
num_scale_back_factor_4 = Number(num_scale_back_factor_3)
tpi = _00_Tangential_Plane_Intersection(
    Starting_Points=pt_7,
    Max_Centers=num_7,
    Surface=srf_11,
    Radius=num_iradius,
    Test_Index=num_6,
    A1=a1,
    A2=a2,
    B1=b1,
    B2=b2,
    Velocity_decrease_at_Iteration=num_2,
    Weight_Distribution_2=num,
    Outside_Tolerance=num_3,
    Add_Edge_Polygon=bool_3,
    Weight_Distribution=num_iweightdistribution,
    Weight_To_Shortest_Edge=num_iweighttoshortestedgeglobal,
    Weight_ToLongest=num_iweighttowardslongest,
    More_Agents_at_lessCurvature=bool_5,
    Stop_adding_agents=bool_4,
    Reset=bool_6,
    MaxIterations=40)  # -> Mesh, Centers, Vectors, Curves, Itertions, Circle, Circle_Edge
preview_13 = CustomPreview(Geometry=[edges_3.Naked, edges_3.Interior], Material=ColourSwatch(SwatchColor=RGB(0, 0, 0)))
# Preview
preview_14 = CustomPreview(Geometry=[edges_2.Naked, edges_2.Interior], Material=ColourSwatch(SwatchColor=RGB(0, 0, 0)))
preview_15 = CustomPreview(Geometry=brep_2, Material=ColourSwatch(SwatchColor=RGB(255, 255, 255)))
preview_16 = CustomPreview(Geometry=[edges.Naked, edges.Interior], Material=ColourSwatch(SwatchColor=RGB(0, 0, 0)))
preview_17 = CustomPreview(Geometry=brep_3, Material=ColourSwatch(SwatchColor=RGB(0, 89, 255)))
partition = PartitionList(List=data, Size="10")  # -> simplify(Chunks)
planar = IsPlanar(Surface=debrep.Faces, Interior=True)  # -> Planar, Plane
crv_sidecurves_beams_2 = Curve(simplify(bfps.BeamSideLines))
closed_brep_6 = _07_ClosedBrep(SideLines=crv_sidecurves, SideJoinTol=0.001, TopLowCapTol=0.001)  # -> ColsedBrep, SideSurfaces
num_slider_or_galapagos_2 = Number(num_slider_or_galapagos)
num_sliders_3 = Number(flatten(num_sliders))
num_scale_back_factor_5 = Number(num_scale_back_factor_2)
tpis = _01_MyProject_TPI_silent(
    Starting_Points=pt_8,
    Max_Centers=num_10,
    Surface=srf_17,
    Radius=num_iradius_2,
    Test_Index=num_9,
    A1=a1_2,
    A2=a2_2,
    B1=b1_2,
    B2=b2_2,
    Velocity_decrease_at_Iteration=num_4,
    Weight_Distribution_2=num_5,
    Outside_Tolerance=num_8,
    Add_Edge_Polygon=bool_7,
    Weight_Distribution=num_iweightdistribution_2,
    Weight_To_Shortest_Edge=num_iweighttoshortestedgeglobal_2,
    Weight_ToLongest=num_iweighttowardslongest_2,
    More_Agents_at_lessCurvature=bool_8,
    Stop_adding_agents=bool_9,
    Reset=False,
    MaxIterations=num_internal_iterations)  # -> Mesh, Centers, Vectors, Curves, Itertions, Circle, Circle_Edge
debrep_2 = DeconstructBrep(Brep=brep_4)  # -> Faces, Edges, Vertices
debrep_3 = DeconstructBrep(Brep=brep_3)  # -> Faces, Edges, Vertices
dispatch = Dispatch(List=debrep.Faces, DispatchPattern=planar.Planar)  # -> ListA, ListB
srf_18 = Surface(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)
circle_main = Circle(tpi.Circle)
circle_edge = Circle(tpi.Circle_Edge)
mesh = Mesh(tpi.Mesh)
pt_9 = Point(tpi.Centers)
crv_15 = Curve(tpi.Curves)
vec = Vector(tpi.Vectors)
panel = Panel(brep_4)
split = SplitList(List=partition, Index="1")  # -> flatten(ListA), simplify(ListB)
brep_6 = Brep(closed_brep_6.ColsedBrep)
panel_2 = Panel(brep_3)
planar_2 = IsPlanar(Surface=debrep_3.Faces, Interior=True)  # -> flatten(Planar), Plane
panel_3 = Panel(brep_2)
srf_19 = Surface(dispatch.ListA)
srf_20 = Surface(dispatch.ListB)
preview_18 = CustomPreview(Geometry=srf_18, Material=ColourSwatch(SwatchColor=RGB(255, 255, 255)))
# Planarity check
debrep_4 = DeconstructBrep(Brep=brep_2)  # -> Faces, Edges, Vertices
# Planarity check
planar_3 = IsPlanar(Surface=debrep_2.Faces, Interior=True)  # -> flatten(Planar), Plane
tstat = TreeStatistics(Tree=split.ListB)  # -> Paths, Length, Count
num_scale_back_factor_6 = Number(num_scale_back_factor_5)
scale = Scale(Geometry=pt_9, Center=Point(0, 0, 0), Factor=num_scale_back_factor_4)  # -> Geometry, Transform
scale_2 = Scale(Geometry=crv_15, Center=Point(0, 0, 0), Factor=num_scale_back_factor_4)  # -> Geometry, Transform
scale_3 = Scale(Geometry=vec, Center=Point(0, 0, 0), Factor=num_scale_back_factor_4)  # -> Geometry, Transform
scale_4 = Scale(Geometry=circle_edge, Center=Point(0, 0, 0), Factor=num_scale_back_factor_4)  # -> Geometry, Transform
scale_5 = Scale(Geometry=mesh, Center=Point(0, 0, 0), Factor=num_scale_back_factor_4)  # -> Geometry, Transform
scale_6 = Scale(Geometry=circle_main, Center=Point(0, 0, 0), Factor=num_scale_back_factor_4)  # -> Geometry, Transform
num_11 = Number(tpi.Itertions)
panel_4 = Panel(split.ListA)
preview_19 = CustomPreview(Geometry=brep_6, Material=ColourSwatch(SwatchColor=RGBA(255, 255, 255, 148)))
dispatch_2 = Dispatch(List=planar_2.Planar, DispatchPattern=planar_2.Planar)  # -> ListA, ListB
planar_4 = IsPlanar(Surface=debrep_4.Faces, Interior=True)  # -> flatten(Planar), Plane
series = Series(Start=0, Step=1, Count=tstat.Count)
# Planarity check
panel_5 = Panel(planar_2.Planar)
psnap = _06_PlanarSnap(
    SideLines=crv_sidecurves_beams_2,
    Surface=srf_18,
    FindSurfaceTolerance=2,
    SurfaceIntersectTolerance=0.02,
    IntersectionLineFactor=100)
dispatch_3 = Dispatch(List=planar_3.Planar, DispatchPattern=planar_3.Planar)  # -> ListA, ListB
panel_6 = Panel(planar_3.Planar)
num_select_variant = Number(num_select_galapagos_variants)
circle_edge_2 = Circle(scale_4.Geometry)
sort = SortList(Keys=panel_4, ValuesA=series)  # -> Keys, reverse(ValuesA)
circle_main_2 = Circle(scale_6.Geometry)
mesh_2 = Mesh(scale_5.Geometry)
pt_10 = Point(scale.Geometry)
vec_2 = Vector(scale_3.Geometry)
crv_16 = Curve(scale_2.Geometry)
crv_17 = Curve(crv_16)
explode = Explode(Curve=crv_17, Recursive=True)  # -> Segments, Vertices
num_12 = Number(num_11)
circle_main_3 = Circle(tpis.Circle)
circle_edge_3 = Circle(tpis.Circle_Edge)
panel_7 = Panel(dispatch_2.ListB)
crv_sidecurves_beams_snapped = Curve(simplify(psnap))
pt_11 = Point(tpis.Centers)
mesh_3 = Mesh(tpis.Mesh)
vec_3 = Vector(tpis.Vectors)
crv_18 = Curve(tpis.Curves)
dispatch_4 = Dispatch(List=planar_4.Planar, DispatchPattern=planar_4.Planar)  # -> ListA, ListB
crv_toppolyline_plate_2 = Curve(crv_toppolyline_plate)
panel_8 = Panel(planar_4.Planar)
crv_sidecurves_plate_2 = Curve(crv_sidecurves_plate)
len = Length(Curve=explode.Segments)
panel_9 = Panel(dispatch_3.ListB)
branch = TreeBranch(Tree=split.ListB, Path=sort.ValuesA, MaintainPaths=True)
avr = Average(Input=len)
scale_7 = Scale(Geometry=pt_11, Center=Point(0, 0, 0), Factor=num_scale_back_factor_6)  # -> Geometry, Transform
scale_8 = Scale(Geometry=crv_18, Center=Point(0, 0, 0), Factor=num_scale_back_factor_6)  # -> Geometry, Transform
scale_9 = Scale(Geometry=vec_3, Center=Point(0, 0, 0), Factor=num_scale_back_factor_6)  # -> Geometry, Transform
scale_10 = Scale(Geometry=circle_edge_3, Center=Point(0, 0, 0), Factor=num_scale_back_factor_6)  # -> Geometry, Transform
scale_11 = Scale(Geometry=mesh_3, Center=Point(0, 0, 0), Factor=num_scale_back_factor_6)  # -> Geometry, Transform
scale_12 = Scale(Geometry=circle_main_3, Center=Point(0, 0, 0), Factor=num_scale_back_factor_6)  # -> Geometry, Transform
num_13 = Number(tpis.Itertions)
panel_10 = Panel(dispatch_4.ListB)
crv_naked_2 = Curve(crv_naked)
branch_2 = TreeBranch(Tree=branch, Path=num_select_variant, MaintainPaths=True)
subtraction = Subtraction(A=len, B=avr)
pt_orient_location = Point(Point(1884.54288, -2632.205488, 0))
abs = Absolute(Value=subtraction)
iterations = Panel(num_12)
num_galapagos_variants = Number(branch_2)
num_galapagos_variants_2 = Number(num_galapagos_variants)
filter = StreamFilter(Gate=num_slider_or_galapagos_2, Stream0=num_sliders_3, Stream1=num_galapagos_variants_2)
item = ListItem(List=filter, Index=0, Wrap=True)  # -> Item, Item1, Item2, Item3, Item4, Item5, Item6, Item7, Item8
triangle_neighbour_normal_angel_effect_2 = Panel(item.Item4)
threshold_applying_normal_angle_effect_2 = Panel(item.Item6)
accuracy_checksteps_at_node_2 = Panel(item.Item7)
thickness_2 = Panel(item.Item)
threshold_applying_inside_angle_effect_2 = Panel(item.Item5)
find_neighbour_check_distance_2 = Panel(item.Item2)
estimated_top_triangle_inside_angle_2 = Panel(item.Item8)
nodeback_2 = Panel(item.Item1)
triangle_inside_angle_effect_2 = Panel(item.Item3)
circle_main_4 = Circle(scale_12.Geometry)
circle_edge_4 = Circle(scale_10.Geometry)
pt_12 = Point(scale_7.Geometry)
num_14 = Number(num_13)
mesh_4 = Mesh(scale_11.Geometry)
vec_4 = Vector(scale_9.Geometry)
crv_19 = Curve(scale_8.Geometry)
crv_20 = Curve(crv_19)
explode_2 = Explode(Curve=crv_20, Recursive=True)  # -> Segments, Vertices
ma = MassAddition(Input=flatten(abs))  # -> Result, PartialResults
len_2 = Length(Curve=explode_2.Segments)
avr_2 = Average(Input=len_2)
num_num_average_edge_deviation = Number(abs)
num_sum_average_edge_deviation = Number(ma.Result)
closed_brep_7 = _07_ClosedBrep(SideLines=crv_sidecurves_beams_snapped, SideJoinTol=0.001, TopLowCapTol=0.001)  # -> ColsedBrep, SideSurfaces
off_dif_p_ad_4_3 = _05_Offset_Different_Polygons_Angle_Dependent_4(
    Polylines=crv_all_plates_3,
    Thickness=thickness_2,
    NodeBackLow=nodeback_2,
    CheckDist=find_neighbour_check_distance_2,
    AngleEffect=triangle_inside_angle_effect_2,
    AngleNormalEffect=triangle_neighbour_normal_angel_effect_2,
    ThresholdAngle=threshold_applying_inside_angle_effect_2,
    ThresholdNormalAngle=threshold_applying_normal_angle_effect_2,
    AdjustFindpointsFactor=0.35,
    CheckStepsNodeback=accuracy_checksteps_at_node_2,
    ApproxMaxTopAngle=estimated_top_triangle_inside_angle_2,
    NakedEdge=crv_naked_2)
subtraction_2 = Subtraction(A=len_2, B=avr_2)
brep_7 = Brep(closed_brep_7.ColsedBrep)
abs_2 = Absolute(Value=subtraction_2)
iterations_2 = Panel(num_14)
crv_sidecurves_plate_3 = Curve(crv_sidecurves_plate_2)
crv_toppolyline_plate_3 = Curve(crv_toppolyline_plate_2)
crv_sidcurves = Curve(off_dif_p_ad_4_3)
ma_2 = MassAddition(Input=flatten(abs_2))  # -> Result, PartialResults
brep_8 = Brep(brep_7)
crv_sidcurves_2 = Curve(crv_sidcurves)
num_num_average_edge_deviation_2 = Number(abs_2)
num_sum_average_edge_deviation_2 = Number(ma_2.Result)
debrep_5 = DeconstructBrep(Brep=brep_8)  # -> flatten(Faces), Edges, Vertices
enumeration = Enumeration(Polylines=crv_toppolyline_plate_3, PlaneMethod=Slider(1, range=0..1), StartIteration=-1, MaxIterations=-1)  # -> Indexes, CenterPlanes
closed_brep_8 = _07_ClosedBrep(SideLines=crv_sidcurves_2, SideJoinTol=0.001, TopLowCapTol=0.001)  # -> ColsedBrep, SideSurfaces
planar_5 = IsPlanar(Surface=debrep_5.Faces, Interior=True)  # -> Planar, Plane
# ORIENT on XY
pln = Plane(enumeration.CenterPlanes)
dispatch_5 = Dispatch(List=planar_5.Planar, DispatchPattern=planar_5.Planar)  # -> ListA, ListB
crv_all_plates_4 = Curve(crv_all_plates_3)
crv_sidcurves_3 = Curve(crv_sidcurves)
lng = ListLength(List=flatten(pln))
non_planar_faces_should_be_empty = Panel(dispatch_5.ListB)
num_scale_back_factor_7 = Number(num_scale_back_factor_3)
brep_9 = Brep(brep)
srf_21 = Surface(srf_8)
pt_orient_location_2 = Point(pt_orient_location)
bfps_2 = Beam_from_Plate_SideLines(Polylines=crv_all_plates_4, OffsetLength=58, IntersectTolerance=0, OffsetDirection=True, SideLines=crv_sidcurves_3)  # -> OffsetBeamPolyline, OffsetPolyline, BeamSideLines
series_2 = Series(Start=0, Step=Slider(1000, range=0..10000), Count=lng)
toplowsrf_2 = _08_TopLowSurface(SideLines=bfps_2.BeamSideLines, TopLowSrfTol=0.001)  # -> TopSurface, LowerSurface, TopPolyline, LowPolyline
X = UnitX(Factor=series_2)
srf_22 = Surface(srf_20)
brep_10 = Brep(closed_brep_8.ColsedBrep)
srf_lower_beam_surface = Surface(toplowsrf_2.LowerSurface)
scale_13 = Scale(Geometry=srf_21, Center=Point(0, 0, 0), Factor=num_scale_back_factor_7)  # -> Geometry, Transform

# ----
# Arrow
number_slider_22 = Slider(0.257, range=0..1)
num_scale_back_factor_8 = Number(num_scale_back_factor_3)
multiplication = Multiplication(A=num_scale_back_factor_8, B=number_slider_22)
multiplication_2 = Multiplication(A=Slider(0.092, range=0..1), B=num_scale_back_factor_8)
multiplication_3 = Multiplication(A=num_scale_back_factor_8, B=Slider(0.077, range=0..1))
srf_23 = Surface(scale_13.Geometry)
pt_13 = Point(pt_10)
vec_5 = Vector(vec_2)
cluster_3 = Cluster(pt=pt_13, vec=vec_5, srf=srf_23, A=multiplication, A_2=multiplication_3, A_3=multiplication_2)  # -> mesh_2, line_3
mesh_5 = Mesh(cluster_3.mesh_2)
line_3 = Line(cluster_3.line_3)

addition = Addition(A=pt_orient_location_2, B=X)

# ----
# move vectors
vec_6 = Vector(vec_2)
pt_14 = Point(pt_10)
unit = UnitVector(Vector=vec_6)
multiplication_4 = Multiplication(A=unit, B=Slider(0.26, range=0..1))
vec_7 = Vector(multiplication_4)
pt_15 = Point(pt_14)
vec_8 = Vector(vec_7)
vdisex_2 = VectorDisplayEx(Point=pt_15, Vector=vec_8, Colour=ColourSwatch(SwatchColor=RGB(26, 0, 158)), Width=Slider(3, range=0..10))

edges_4 = BrepEdges(Brep=brep_10)  # -> Naked, Interior, NonManifold
closed_brep_9 = _07_ClosedBrep(SideLines=bfps_2.BeamSideLines, SideJoinTol=0.001, TopLowCapTol=0.001)  # -> ColsedBrep, SideSurfaces
debrep_6 = DeconstructBrep(Brep=brep_9)  # -> flatten(Faces), Edges, Vertices
num_thickness_plate_5 = Number(num_thickness_plate)
xy = XYPlane(Origin=addition)
num_scale_back_factor_9 = Number(num_scale_back_factor_5)
srf_24 = Surface(srf_10)

# ----
# design surface
number_slider_23 = Slider(2, range=0..10)
srf_25 = Surface(scale_13.Geometry)
divide_4 = DivideDomain²(Domain=srf_25, UCount=number_slider_23, VCount=number_slider_23)
subsrf = Isotrim(Surface=srf_25, Domain=divide_4)
srf_26 = Surface(subsrf)

# ----
# SO FAR BEST RESULTS!
preview_20 = CustomPreview(Geometry=brep_10, Material=ColourSwatch(SwatchColor=RGBA(255, 255, 255, 105)))
brep_11 = Brep(closed_brep_9.ColsedBrep)
preview_21 = CustomPreview(Geometry=[edges_4.Naked, edges_4.Interior], Material=ColourSwatch(SwatchColor=RGBA(0, 0, 0, 105)))
preview_22 = CustomPreview(Geometry=srf_22, Material=ColourSwatch(SwatchColor=RGB(255, 0, 0)))
preview_23 = CustomPreview(Geometry=brep_9, Material=ColourSwatch(SwatchColor=RGBA(255, 255, 255, 113)))
preview_24 = CustomPreview(Geometry=debrep_6.Edges, Material=ColourSwatch(SwatchColor=RGB(0, 0, 0)))

# ----
# Differetial growth polyline
pt_16 = Point(pt_10)
pline_3 = PolyLine(Vertices=pt_16, Closed=False)

# ----
# Delaunay mesh
mesh_6 = Mesh(mesh_2)
faceb = FaceBoundaries(Mesh=mesh_6)
crv_21 = Curve(faceb)

crv_sidecurves_plate_4 = Curve(simplify(crv_sidecurves_plate_3))
brep_12 = Brep(brep_7)
planemoverotflip = PlaneMoveRotFlip(
    Plane=xy,
    Rotate=Slider(90, range=0..100),
    FlipPlane=0,
    MoveX=0,
    MoveY=0,
    MoveZ=num_thickness_plate_5,
    PlaneXvec=Vector(0, 0, 0))

# ----
# PLANAR POLYGONS
crv_22 = Curve(graft(crv_16))
boundary = BoundarySurfaces(Edges=crv_22)
crv_23 = Curve(crv_22)
srf_27 = Surface(boundary)

edges_5 = BrepEdges(Brep=brep_12)  # -> Naked, Interior, NonManifold
scale_14 = Scale(Geometry=srf_24, Center=Point(0, 0, 0), Factor=num_scale_back_factor_9)  # -> Geometry, Transform

# ----
# Arrow
number_slider_24 = Slider(0.257, range=0..1)
num_scale_back_factor_10 = Number(num_scale_back_factor_5)
multiplication_5 = Multiplication(A=num_scale_back_factor_10, B=number_slider_24)
multiplication_6 = Multiplication(A=num_scale_back_factor_10, B=Slider(0.077, range=0..1))
multiplication_7 = Multiplication(A=num_scale_back_factor_10, B=Slider(0.092, range=0..1))
srf_28 = Surface(scale_14.Geometry)
pt_17 = Point(pt_12)
vec_9 = Vector(vec_4)
cluster_4 = Cluster(pt=pt_17, vec=vec_9, srf=srf_28, A=multiplication_5, A_2=multiplication_6, A_3=multiplication_7)  # -> mesh_2, line_3
mesh_7 = Mesh(cluster_4.mesh_2)
line_4 = Line(cluster_4.line_3)

# ----
# move vectors
vec_10 = Vector(vec_4)
pt_18 = Point(pt_12)
unit_2 = UnitVector(Vector=vec_10)
multiplication_8 = Multiplication(A=unit_2, B=Slider(0.26, range=0..1))
vec_11 = Vector(multiplication_8)
pt_19 = Point(pt_18)
vec_12 = Vector(vec_11)
vdisex_3 = VectorDisplayEx(Point=pt_19, Vector=vec_12, Colour=ColourSwatch(SwatchColor=RGB(26, 0, 158)), Width=Slider(3, range=0..10))

pln_2 = Plane(simplify(graft(pln)))
crv_toppolyline_plate_4 = Curve(simplify(graft(crv_toppolyline_plate_3)))
pln_3 = Plane(simplify(graft(planemoverotflip)))

# ----
# Circles
circle_main_5 = Circle(circle_main_2)
circle_edge_5 = Circle(circle_edge_2)

preview_25 = CustomPreview(Geometry=brep_12, Material=ColourSwatch(SwatchColor=RGBA(255, 255, 255, 105)))
preview_26 = CustomPreview(Geometry=[edges_5.Naked, edges_5.Interior], Material=ColourSwatch(SwatchColor=RGBA(0, 0, 0, 105)))

# ----
# design surface
number_slider_25 = Slider(2, range=0..10)
srf_29 = Surface(scale_14.Geometry)
divide_5 = DivideDomain²(Domain=srf_29, UCount=number_slider_25, VCount=number_slider_25)
subsrf_2 = Isotrim(Surface=srf_29, Domain=divide_5)
srf_30 = Surface(subsrf_2)

orient = Orient(Geometry=crv_sidecurves_plate_4, Source=pln_2, Target=pln_3)  # -> Geometry, Transform

# ----
# Differetial growth polyline
pt_20 = Point(pt_12)
pline_4 = PolyLine(Vertices=pt_20, Closed=False)

# ----
# Delaunay mesh
mesh_8 = Mesh(mesh_4)
faceb_2 = FaceBoundaries(Mesh=mesh_8)
crv_24 = Curve(faceb_2)

orient_2 = Orient(Geometry=crv_toppolyline_plate_4, Source=pln_2, Target=pln_3)  # -> Geometry, Transform

# ----
# PLANAR POLYGONS
crv_25 = Curve(graft(crv_19))
boundary_2 = BoundarySurfaces(Edges=crv_25)
crv_26 = Curve(crv_25)
srf_31 = Surface(boundary_2)

crv_sidecurves_plate_oriented = Curve(simplify(orient.Geometry))
crv_toppolyline_plate_oriented = Curve(flatten(orient_2.Geometry))

# ----
# Circles
circle_main_6 = Circle(circle_main_4)
circle_edge_6 = Circle(circle_edge_4)

panel_11 = Panel(srf_27)
srf_32 = Surface(simplify(srf_27))
srf_lower_beam_surface_2 = Surface(flatten(srf_lower_beam_surface))
crv_toppolyline_plate_5 = Curve(crv_toppolyline_plate_oriented)
crv_sidecurves_plate_5 = Curve(crv_sidecurves_plate_oriented)
crv_toppolyline_plate_6 = Curve(crv_toppolyline_plate_2)
crv_sidecurves_plate_6 = Curve(crv_sidecurves_plate_2)
panel_12 = Panel(srf_31)
explode_3 = Explode(Curve=srf_lower_beam_surface_2, Recursive=True)  # -> Segments, Vertices
preview_27 = CustomPreview(Geometry=srf_32, Material=ColourSwatch(SwatchColor=RGBA(255, 191, 0, 43)))
srf_33 = Surface(srf_26)
lng_2 = ListLength(List=explode_3.Vertices)  # -> flatten(Length)
srf_34 = Surface(srf_25)
srf_35 = Surface(simplify(srf_31))
crv_27 = Curve(pline_3)
num_scale_back_factor_11 = Number(num_scale_back_factor_4)
smaller = SmallerThan(FirstNumber=lng_2, SecondNumber="7")  # -> SmallerThan, OrEqualTo

# ----
# gradiant colours
num_edge_dev = Number(num_num_average_edge_deviation)
srf_plates = Surface(simplify(srf_27))
cluster_5 = Cluster_2(srf_plates=srf_plates, num_edge_dev=num_edge_dev, num_scale_back_factor=num_scale_back_factor_11)  # -> srf_plates_4, col_3
srf_plates_2 = Surface(simplify(cluster_5.srf_plates_4))
col = Colour(cluster_5.col_3)
preview_28 = CustomPreview(Geometry=srf_plates_2, Material=col)

swatch = ColourSwatch(SwatchColor=RGB(135, 135, 135))
line_5 = Line(line_3)
dispatch_6 = Dispatch(List=smaller.SmallerThan, DispatchPattern=smaller.SmallerThan)  # -> ListA, ListB
brep_13 = Brep(flatten(brep_11))
area_3 = Area(Geometry=srf_lower_beam_surface_2)  # -> Area, Centroid
circle_main_7 = Circle(circle_main_5)
edges_6 = BrepEdges(Brep=srf_33)  # -> Naked, Interior, NonManifold
circle_edge_7 = Circle(circle_edge_5)
edges_7 = BrepEdges(Brep=srf_34)  # -> Naked, Interior, NonManifold
lng_3 = ListLength(List=dispatch_6.ListA)  # -> flatten(Length)
preview_29 = CustomPreview(Geometry=crv_27, Material=swatch)
crv_28 = Curve(crv_23)
preview_30 = CustomPreview(Geometry=srf_35, Material=ColourSwatch(SwatchColor=RGBA(255, 191, 0, 43)))
srf_36 = Surface(srf_30)
ma_3 = MassAddition(Input=area_3.Area)  # -> Result, PartialResults
lng_4 = ListLength(List=brep_13)
srf_37 = Surface(srf_29)
crv_29 = Curve(pline_4)
swatch_2 = ColourSwatch(SwatchColor=RGB(8, 8, 8))
swatch_3 = ColourSwatch(SwatchColor=RGB(145, 145, 145))
larger = LargerThan(FirstNumber=lng_3, SecondNumber="0")  # -> LargerThan, OrEqualTo
crv_30 = Curve(crv_21)
num_scale_back_factor_12 = Number(num_scale_back_factor_6)
multiplication_9 = Multiplication(A=lng_4, B=Slider(32, range=0..100))
number_slider_26 = Slider(20000, range=0..100000)

# ----
# gradiant colours
num_edge_dev_2 = Number(num_num_average_edge_deviation_2)
srf_plates_3 = Surface(simplify(srf_31))
cluster_6 = Cluster_2(srf_plates=srf_plates_3, num_edge_dev=num_edge_dev_2, num_scale_back_factor=num_scale_back_factor_12)  # -> srf_plates_4, col_3
srf_plates_4 = Surface(simplify(cluster_6.srf_plates_4))
col_2 = Colour(cluster_6.col_3)
preview_31 = CustomPreview(Geometry=srf_plates_4, Material=col_2)

division = Division(A=ma_3.Result, B=Slider(7323, range=0..10000))
swatch_4 = ColourSwatch(SwatchColor=RGB(135, 135, 135))
panel_13 = Panel(larger.LargerThan)
line_6 = Line(line_4)
round = Round(Number=division)  # -> Nearest, Floor, Ceiling
panel_14 = Panel(multiplication_9)
circle_main_8 = Circle(circle_main_6)
edges_8 = BrepEdges(Brep=srf_36)  # -> Naked, Interior, NonManifold
circle_edge_8 = Circle(circle_edge_6)
edges_9 = BrepEdges(Brep=srf_37)  # -> Naked, Interior, NonManifold
panel_15 = Panel(round.Nearest)
neg = Negative(Value=number_slider_26)
preview_32 = CustomPreview(Geometry=crv_29, Material=swatch_4)
crv_31 = Curve(crv_26)
filter_2 = StreamFilter(Gate=panel_13, Stream0=number_slider_26, Stream1=neg)
swatch_5 = ColourSwatch(SwatchColor=RGB(8, 8, 8))
preview_33 = CustomPreview(Geometry=srf_33, Material=ColourSwatch(SwatchColor=RGBA(0, 0, 0, 30)))
preview_34 = CustomPreview(Geometry=mesh_5, Material=ColourSwatch(SwatchColor=RGB(255, 255, 255)))
preview_35 = CustomPreview(Geometry=crv_30, Material=ColourSwatch(SwatchColor=RGB(217, 217, 217)))
previewlw = CustomPreviewLineweights(Geometry=edges_7.Naked, Shader=ColourSwatch(SwatchColor=RGB(0, 0, 0)), Thickness=Slider(2, range=0..10), Absolute=False)
previewlw_2 = CustomPreviewLineweights(
    Geometry=edges_6.Naked,
    Shader=ColourSwatch(SwatchColor=RGB(97, 97, 97)),
    Thickness=Slider(1, range=0..10),
    Absolute=False)
previewlw_3 = CustomPreviewLineweights(Geometry=line_5, Shader=ColourSwatch(SwatchColor=RGB(43, 43, 43)), Thickness=Slider(2, range=0..10), Absolute=False)
previewlw_4 = CustomPreviewLineweights(Geometry=crv_27, Shader=swatch, Thickness=Slider(4, range=0..10), Absolute=False)
previewlw_5 = CustomPreviewLineweights(Geometry=crv_28, Shader=ColourSwatch(SwatchColor=RGB(0, 0, 0)), Thickness=Slider(3, range=0..10), Absolute=False)
preview_36 = CustomPreview(Geometry=circle_main_7, Material=swatch_3)
preview_37 = CustomPreview(Geometry=circle_edge_7, Material=swatch_3)
swatch_6 = ColourSwatch(SwatchColor=RGB(145, 145, 145))
crv_32 = Curve(crv_24)
panel_16 = Panel(filter_2)
num_15 = Number(flatten([panel_14, panel_15, "0", panel_16]))
ma_4 = MassAddition(Input=num_15)  # -> Result, PartialResults
preview_38 = CustomPreview(Geometry=srf_36, Material=ColourSwatch(SwatchColor=RGBA(0, 0, 0, 30)))
preview_39 = CustomPreview(Geometry=mesh_7, Material=ColourSwatch(SwatchColor=RGB(255, 255, 255)))
preview_40 = CustomPreview(Geometry=crv_32, Material=ColourSwatch(SwatchColor=RGB(217, 217, 217)))
previewlw_6 = CustomPreviewLineweights(Geometry=edges_9.Naked, Shader=ColourSwatch(SwatchColor=RGB(0, 0, 0)), Thickness=Slider(2, range=0..10), Absolute=False)
previewlw_7 = CustomPreviewLineweights(
    Geometry=edges_8.Naked,
    Shader=ColourSwatch(SwatchColor=RGB(97, 97, 97)),
    Thickness=Slider(1, range=0..10),
    Absolute=False)
previewlw_8 = CustomPreviewLineweights(Geometry=line_6, Shader=ColourSwatch(SwatchColor=RGB(43, 43, 43)), Thickness=Slider(2, range=0..10), Absolute=False)
previewlw_9 = CustomPreviewLineweights(Geometry=crv_29, Shader=swatch_4, Thickness=Slider(4, range=0..10), Absolute=False)
previewlw_10 = CustomPreviewLineweights(Geometry=crv_31, Shader=ColourSwatch(SwatchColor=RGB(0, 0, 0)), Thickness=Slider(3, range=0..10), Absolute=False)
preview_41 = CustomPreview(Geometry=circle_main_8, Material=swatch_6)
preview_42 = CustomPreview(Geometry=circle_edge_8, Material=swatch_6)
num_maximize = Number(ma_4.Result)
num_maximize_2 = Number(num_maximize)
larger_2 = LargerThan(FirstNumber=num_maximize_2, SecondNumber=threshold_to_record)  # -> LargerThan, OrEqualTo
merge_2 = Merge(Data1=flatten(num_maximize_2), Data2=flatten(num_sliders_2))  # -> flatten(Result)
filter_3 = StreamFilter(Gate=larger_2.LargerThan, Stream1=merge_2)
rec = DataRecorder(filter_3, DataLimit=-10, RecordData=False)  # disabled
data_2 = Data(rec)
crv_toppolyline_plate_7 = Curve(flatten(crv_toppolyline_plate_6))
panel_17 = Panel(ma_4.Result)
panel_18 = Panel(num_maximize)
crv_toppolyline_plate_8 = Curve(crv_toppolyline_plate_6)
crv_toppolyline_plate_9 = Curve(crv_toppolyline_plate_6)
brep_14 = Brep(brep_11)
crv_sidecurves_plate_7 = Curve(crv_sidecurves_plate_6)
crv_toppolyline_plate_10 = Curve(crv_toppolyline_plate_6)
flip_3 = FlipCurve(Curve=crv_toppolyline_plate_9)  # -> Curve, Flag
# Side Angles
flip_4 = FlipCurve(Curve=crv_sidecurves_plate_7)  # -> Curve, Flag
crv_sidecurves_plate_8 = Curve(crv_sidecurves_plate_5)
crv_toppolyline_plate_11 = Curve(crv_toppolyline_plate_5)
# 04 Visualize Angles Lenths and Enumearation   -   ORIENTED
crv_toppolyline_plate_12 = Curve(crv_toppolyline_plate_5)
crv_toppolyline_plate_13 = Curve(crv_toppolyline_plate_5)
crv_toppolyline_plate_14 = Curve(crv_toppolyline_plate_5)
# Neighbourhood
neighbourhood = Neighbourhood(Polylines=crv_toppolyline_plate_7, EdgeText="E", CheckDist=0.01, StartIteration=-1, MaxIterations=-1)  # -> Indexes, Planes
# Side Lenght
sidelenght = SideLenght(Polylines=crv_toppolyline_plate_10, Round=1, StartIteration=-1, MaxIterations=-1)  # -> Lengths, Planes
# 04 Visualize Angles Lenths and Enumearation
# Enumeration
enumeration_2 = Enumeration(Pl=crv_toppolyline_plate_8, PlaneMethod=0, StartIteration=-1, MaxIterations=-1)  # -> Indexes, CenterPlanes
# Inside Angle
insideangle = InsideAngle(
    Polylines=crv_toppolyline_plate_9,
    Round=1,
    OffsetLength=40,
    OffsetDirection=True,
    OffsetTol=0,
    StartIteration=-1,
    MaxIterations=-1)  # -> Angles, Planes
side_angles = SideAngles(Line=flip_4.Curve, DegreePlus=0, Round=1, StartIteration=-1, MaxIterations=-1)  # -> Angles, Planes
flip_5 = FlipCurve(Curve=crv_sidecurves_plate_8)  # -> Curve, Flag
txt_neighbourhood = Text(neighbourhood.Indexes)
# Neighbourhood
neighbourhood_2 = Neighbourhood(Polylines=crv_toppolyline_plate_14, EdgeText="E", CheckDist=0.01, StartIteration=-1, MaxIterations=-1)  # -> Indexes, Planes
# Side Lenght
sidelenght_2 = SideLenght(Polylines=crv_toppolyline_plate_13, Round=1, StartIteration=-1, MaxIterations=-1)  # -> Lengths, Planes
# Enumeration
enumeration_3 = Enumeration(Pl=crv_toppolyline_plate_12, PlaneMethod=0, StartIteration=-1, MaxIterations=-1)  # -> Indexes, CenterPlanes
# Inside Angle
insideangle_2 = InsideAngle(
    Polylines=crv_toppolyline_plate_11,
    Round=1,
    OffsetLength=40,
    OffsetDirection=True,
    OffsetTol=0,
    StartIteration=-1,
    MaxIterations=-1)  # -> Angles, Planes
# Side Angles
side_angles_2 = SideAngles(Line=flip_5.Curve, DegreePlus=0, Round=1, StartIteration=-1, MaxIterations=-1)  # -> Angles, Planes
edges_10 = BrepEdges(Brep=brep_14)  # -> Naked, Interior, NonManifold
neg_2 = Negative(Value=Slider(100, range=0..1000))
neg_3 = Negative(Value=Slider(90, range=0..100))
preview_43 = CustomPreview(Geometry=brep_14, Material=ColourSwatch(SwatchColor=RGBA(255, 255, 255, 105)))
preview_44 = CustomPreview(Geometry=[edges_10.Naked, edges_10.Interior], Material=ColourSwatch(SwatchColor=RGBA(0, 0, 0, 105)))
txt_neighbourhood_2 = Text(txt_neighbourhood)
planemoverotflip_2 = PlaneMoveRotFlip(Plane=enumeration_2.CenterPlanes, Rotate=0, FlipPlane=0, MoveX=neg_2, MoveY=0, MoveZ=0, PlaneXvec=Vector(0, 0, 0))
planemoverotflip_3 = PlaneMoveRotFlip(
    Plane=sidelenght.Planes,
    Rotate=0,
    FlipPlane=0,
    MoveX=neg_3,
    MoveY=Slider(20, range=0..100),
    MoveZ=0,
    PlaneXvec=Vector(0, 0, 0))
planemoverotflip_4 = PlaneMoveRotFlip(
    Plane=neighbourhood.Planes,
    Rotate=0,
    FlipPlane=0,
    MoveX=Slider(100, range=0..100),
    MoveY=Slider(20, range=0..100),
    MoveZ=0,
    PlaneXvec=Vector(0, 0, 0))
planemoverotflip_5 = PlaneMoveRotFlip(
    Plane=side_angles.Planes,
    Rotate=0,
    FlipPlane=0,
    MoveX=Slider(0, range=0..100),
    MoveY=Slider(20, range=0..100),
    MoveZ=Slider(0.22, range=0..1),
    PlaneXvec=Vector(0, 0, 0))
neg_4 = Negative(Value=Slider(100, range=0..1000))
neg_5 = Negative(Value=Slider(90, range=0..100))
planemoverotflip_6 = PlaneMoveRotFlip(Plane=enumeration_3.CenterPlanes, Rotate=0, FlipPlane=0, MoveX=neg_4, MoveY=0, MoveZ=0, PlaneXvec=Vector(0, 0, 0))
planemoverotflip_7 = PlaneMoveRotFlip(
    Plane=planemoverotflip_2,
    Rotate=0,
    FlipPlane=0,
    MoveX=Slider(100, range=0..1000),
    MoveY=0,
    MoveZ=0,
    PlaneXvec=Vector(0, 0, 0))
planemoverotflip_8 = PlaneMoveRotFlip(
    Plane=sidelenght_2.Planes,
    Rotate=0,
    FlipPlane=0,
    MoveX=neg_5,
    MoveY=Slider(20, range=0..100),
    MoveZ=0,
    PlaneXvec=Vector(0, 0, 0))
planemoverotflip_9 = PlaneMoveRotFlip(
    Plane=neighbourhood_2.Planes,
    Rotate=0,
    FlipPlane=0,
    MoveX=Slider(65.34, range=0..100),
    MoveY=Slider(20, range=0..100),
    MoveZ=0,
    PlaneXvec=Vector(0, 0, 0))
planemoverotflip_10 = PlaneMoveRotFlip(
    Plane=side_angles_2.Planes,
    Rotate=0,
    FlipPlane=0,
    MoveX=Slider(0, range=0..100),
    MoveY=Slider(20, range=0..100),
    MoveZ=Slider(0.22, range=0..1),
    PlaneXvec=Vector(0, 0, 0))
planemoverotflip_11 = PlaneMoveRotFlip(
    Plane=planemoverotflip_6,
    Rotate=0,
    FlipPlane=0,
    MoveX=Slider(100, range=0..1000),
    MoveY=0,
    MoveZ=0,
    PlaneXvec=Vector(0, 0, 0))
text = Text(MainText=enumeration_2.Indexes, Planes=planemoverotflip_2, Font="Centurygotic", FontSize=50, Bold=False)
text_2 = Text(
    Starttext="S  ",
    MainText=side_angles.Angles,
    EndText="  °",
    Planes=planemoverotflip_5,
    Font="Centurygotic",
    FontSize=Slider(10, range=0..100),
    Bold=False)
text_3 = Text(MainText="c HRC", Planes=planemoverotflip_7, Font="Centurygotic", FontSize=Slider(20, range=0..100), Bold=False)
text_4 = Text(
    Starttext="NH_",
    MainText=txt_neighbourhood,
    Planes=planemoverotflip_4,
    Font="Centurygotic",
    FontSize=Slider(10, range=0..100),
    Bold=False)
text_5 = Text(
    MainText=sidelenght.Lengths,
    EndText="  mm",
    Planes=planemoverotflip_3,
    Font="Centurygotic",
    FontSize=Slider(10, range=0..100),
    Bold=False)
text_6 = Text(
    Starttext="T  ",
    MainText=insideangle.Angles,
    EndText="  °",
    Planes=insideangle.Planes,
    Font="Centurygotic",
    FontSize=Slider(10, range=0..100),
    Bold=False)
text_7 = Text(MainText=enumeration_3.Indexes, Planes=planemoverotflip_6, Font="Centurygotic", FontSize=50, Bold=False)
crv_inside_angle = Curve(text_6)
crv_length = Curve(text_5)
crv_numeration = Curve(text)
crv_numeration_advertisement = Curve(text_3)
crv_neighbourhood = Curve(text_4)
crv_side_angles = Curve(text_2)
text_8 = Text(
    Starttext="S  ",
    MainText=side_angles_2.Angles,
    EndText="  °",
    Planes=planemoverotflip_10,
    Font="Centurygotic",
    FontSize=Slider(10, range=0..100),
    Bold=False)
text_9 = Text(MainText="c HRC", Planes=planemoverotflip_11, Font="Centurygotic", FontSize=Slider(20, range=0..100), Bold=False)
text_10 = Text(
    Starttext="NH_",
    MainText=txt_neighbourhood_2,
    Planes=planemoverotflip_9,
    Font="Centurygotic",
    FontSize=Slider(10, range=0..100),
    Bold=False)
text_11 = Text(
    MainText=sidelenght_2.Lengths,
    EndText="  mm",
    Planes=planemoverotflip_8,
    Font="Centurygotic",
    FontSize=Slider(10, range=0..100),
    Bold=False)
text_12 = Text(
    Starttext="T  ",
    MainText=insideangle_2.Angles,
    EndText="  °",
    Planes=insideangle_2.Planes,
    Font="Centurygotic",
    FontSize=Slider(10, range=0..100),
    Bold=False)
crv_numeration_2 = Curve(text_7)
crv_numeration_advertisement_2 = Curve(text_9)
crv_neighbourhood_2 = Curve(text_10)
crv_inside_angle_2 = Curve(text_12)
crv_length_2 = Curve(text_11)
crv_side_angles_2 = Curve(text_8)
crv_sidecurves_plate_oriented_2 = Curve(simplify(crv_sidecurves_plate_5))
# Preview
crv_numeration_3 = Curve(crv_numeration)
crv_numeration_advertisement_3 = Curve(crv_numeration_advertisement)
crv_inside_angle_3 = Curve(crv_inside_angle)
crv_side_angles_3 = Curve(crv_side_angles)
crv_neighbourhood_3 = Curve(crv_neighbourhood)
crv_length_3 = Curve(crv_length)
# Preview Oriented
# Preview
crv_numeration_4 = Curve(crv_numeration_2)
crv_numeration_advertisement_4 = Curve(crv_numeration_advertisement_2)
crv_neighbourhood_4 = Curve(crv_neighbourhood_2)
crv_inside_angle_4 = Curve(crv_inside_angle_2)
crv_length_4 = Curve(crv_length_2)
crv_side_angles_4 = Curve(crv_side_angles_2)
closed_brep_10 = ClosedBrep(SideCurves=crv_sidecurves_plate_oriented_2, SideJoinTol=0.001, TopLowCapTol=0.001)  # -> ColsedBrep, TopSurface
crv_33 = Curve([crv_numeration_3, crv_numeration_advertisement_3, crv_neighbourhood_3, crv_inside_angle_3, crv_length_3, crv_side_angles_3])
crv_34 = Curve([crv_numeration_4, crv_numeration_advertisement_4, crv_neighbourhood_4, crv_inside_angle_4, crv_length_4, crv_side_angles_4])
preview_45 = CustomPreview(Geometry=crv_neighbourhood_3, Material=ColourSwatch(SwatchColor=RGB(0, 0, 0)))
preview_46 = CustomPreview(Geometry=crv_inside_angle_3, Material=ColourSwatch(SwatchColor=RGB(0, 0, 0)))
brep_15 = Brep(closed_brep_10.ColsedBrep)
srf_38 = Surface(closed_brep_10.TopSurface)
srf_39 = Surface()
srf_40 = Surface()
preview_47 = CustomPreview(Geometry=crv_numeration_3, Material=ColourSwatch(SwatchColor=RGB(0, 0, 0)))
preview_48 = CustomPreview(Geometry=crv_numeration_advertisement_3, Material=ColourSwatch(SwatchColor=RGB(0, 0, 0)))
preview_49 = CustomPreview(Geometry=crv_length_3, Material=ColourSwatch(SwatchColor=RGB(0, 0, 0)))
preview_50 = CustomPreview(Geometry=crv_side_angles_3, Material=ColourSwatch(SwatchColor=RGB(0, 0, 0)))
edges_11 = BrepEdges(Brep=brep_15)  # -> Naked, Interior, NonManifold
preview_51 = CustomPreview(Geometry=crv_neighbourhood_4, Material=ColourSwatch(SwatchColor=RGB(0, 0, 0)))
preview_52 = CustomPreview(Geometry=crv_inside_angle_4, Material=ColourSwatch(SwatchColor=RGB(0, 0, 0)))
preview_53 = CustomPreview(Geometry=crv_numeration_4, Material=ColourSwatch(SwatchColor=RGB(0, 0, 0)))
preview_54 = CustomPreview(Geometry=crv_numeration_advertisement_4, Material=ColourSwatch(SwatchColor=RGB(0, 0, 0)))
preview_55 = CustomPreview(Geometry=crv_length_4, Material=ColourSwatch(SwatchColor=RGB(0, 0, 0)))
preview_56 = CustomPreview(Geometry=crv_side_angles_4, Material=ColourSwatch(SwatchColor=RGB(0, 0, 0)))
preview_57 = CustomPreview(Geometry=[edges_11.Interior, edges_11.Naked], Material=ColourSwatch(SwatchColor=RGB(0, 0, 0)))
preview_58 = CustomPreview(Geometry=brep_15, Material=ColourSwatch(SwatchColor=RGB(255, 255, 255)))
preview_59 = CustomPreview(Geometry=srf_38, Material=ColourSwatch(SwatchColor=RGBA(255, 255, 255, 98)))
preview_60 = CustomPreview(Geometry=srf_39, Material=ColourSwatch(SwatchColor=RGBA(0, 0, 0, 44)))
preview_61 = CustomPreview(Geometry=srf_40, Material=ColourSwatch(SwatchColor=RGBA(0, 38, 255, 98)))
crv_35 = Curve(crv_33)
preview_62 = CustomPreview(Geometry=crv_35, Material=ColourSwatch(SwatchColor=RGB(0, 0, 0)))
crv_36 = Curve(crv_34)
preview_63 = CustomPreview(Geometry=crv_36, Material=ColourSwatch(SwatchColor=RGB(0, 0, 0)))

# ==== cluster Cluster
pt = ClusterInput()
A = ClusterInput()
vec = ClusterInput()
srf = ClusterInput()
A_2 = ClusterInput()
A_3 = ClusterInput()
pt_2 = Point(pt)
srf_2 = Surface(srf)
vec_2 = Vector(vec)
srf_cp = SurfaceClosestPoint(Point=pt_2, Surface=srf_2)  # -> Point, UVPoint, Distance
evalsrf = EvaluateSurface(Surface=srf_2, Point=srf_cp.UVPoint)  # -> Point, Normal, UDirection, VDirection, Frame
pln = Plane(evalsrf.Frame)
unit = UnitVector(Vector=vec_2)
multiplication = Multiplication(A=unit, B=Slider(0.26, range=0..1))
deplane = DeconstructPlane(Plane=pln)  # -> Origin, XAxis, YAxis, ZAxis
project = Project(Geometry=vec_2, Plane=pln)  # -> Geometry, Transform
amp = Amplitude(Vector=project.Geometry, Amplitude=A)
amp_2 = Amplitude(Vector=project.Geometry, Amplitude=A_2)
pl = ConstructPlane(Origin=deplane.Origin, XAxis=project.Geometry, YAxis=deplane.XAxis)
neg = Negative(Value=amp_2)
deplane_2 = DeconstructPlane(Plane=pl)  # -> Origin, XAxis, YAxis, ZAxis
amp_3 = Amplitude(Vector=deplane_2.YAxis, Amplitude=A_3)
neg_2 = Negative(Value=amp_3)
addition = Addition(A=deplane.Origin, B=neg)
addition_2 = Addition(A=addition, B=neg_2)  # -> graft(Result)
addition_3 = Addition(A=addition, B=amp_3)  # -> graft(Result)
addition_4 = Addition(A=deplane.Origin, B=amp)  # -> graft(Result)
ln = Line(StartPoint=addition_2, EndPoint=addition_3)  # -> graft(Line); disabled
ln_2 = Line(StartPoint=addition_2, EndPoint=addition_4)  # -> graft(Line); disabled
ln_3 = Line(StartPoint=addition_3, EndPoint=addition_4)  # -> graft(Line); disabled
triangle = MeshTriangle(CornerA=0, CornerB=1, CornerC=2)
conmesh = ConstructMesh(Vertices=[addition_2, addition_3, addition_4], Faces=triangle)
line = Line([ln, ln_2, ln_3])  # disabled
mesh = Mesh(conmesh)
faceb = FaceBoundaries(Mesh=mesh)
mesh_2 = ClusterOutput(mesh)
explode = Explode(Curve=faceb, Recursive=True)  # -> Segments, Vertices
line_2 = Line(explode.Segments)
line_3 = ClusterOutput(line_2)

# ==== cluster Cluster_2
num_scale_back_factor = ClusterInput()
num_scale_back_factor_2 = Number(num_scale_back_factor)
num_edge_dev = ClusterInput()
num_edge_dev_2 = Number(num_edge_dev)
num_scale_back_factor_3 = Number(num_scale_back_factor_2)
srf_plates = ClusterInput()
srf_plates_2 = Surface(simplify(srf_plates))
multiplication = Multiplication(A=num_edge_dev_2, B=num_scale_back_factor_3)
num_scale_back_factor_4 = Number(num_scale_back_factor_2)
ma = MassAddition(Input=num_edge_dev_2)  # -> simplify(Result), PartialResults
multiplication_2 = Multiplication(A=Slider(0.73, range=0..10), B=num_scale_back_factor_4)
multiplication_3 = Multiplication(A=Slider(3.78, range=0..10), B=num_scale_back_factor_4)
num_scale_back_factor_5 = Number(num_scale_back_factor_2)
division = Division(A=Slider(1, range=0..1), B=num_scale_back_factor_5)
gradient = Gradient(
    LowerLimit=multiplication_2,
    UpperLimit=multiplication_3,
    Parameter=ma.Result,
    stops=[0: RGB(0, 128, 0), 0.5: RGB(255, 255, 0), 1: RGB(255, 0, 0)])
num_scale_back_factor_6 = Number(num_scale_back_factor_5)
multiplication_4 = Multiplication(A=Slider(2.34, range=0..10), B=num_scale_back_factor_6)
dom = ConstructDomain(DomainStart=Slider(0, range=0..10), DomainEnd=multiplication_4)
remap = RemapNumbers(Value=ma.Result, Source=dom, Target=Domain(0, 1))  # -> Mapped, Clipped
col = Colour(gradient)
srf_plates_3 = Surface(simplify(srf_plates_2))
col_2 = Colour(col)
srf_plates_4 = ClusterOutput(srf_plates_3)
preview = CustomPreview(Geometry=srf_plates_3, Material=col)
col_3 = ClusterOutput(col_2)

# ==== cluster Cluster_3
srf = ClusterInput()
srf_2 = Surface(srf)
srf_3 = Surface(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)
bbox = BoundingBox(Content=srf_2, Plane=PlaneXY(0, 0, 0))  # -> Box, Box_2
bbox_2 = BoundingBox(Content=srf_3, Plane=PlaneXY(0, 0, 0))  # -> Box, Box_2
debrep = DeconstructBrep(Brep=bbox.Box)  # -> Faces, Edges, Vertices
debrep_2 = DeconstructBrep(Brep=bbox_2.Box)  # -> Faces, Edges, Vertices
len = Length(Curve=debrep.Edges)
len_2 = Length(Curve=debrep_2.Edges)
sort = SortList(Keys=len, ValuesA=debrep.Edges)  # -> reverse(Keys), reverse(ValuesA)
sort_2 = SortList(Keys=len_2, ValuesA=debrep_2.Edges)  # -> reverse(Keys), reverse(ValuesA)
item = ListItem(List=sort_2.Keys, Index=0, Wrap=True)
# Scale to tpi possible size
sddp = ShapeDiverDocumentPayload({AbsoluteTolerance=0, AngleTolerance=0, DistanceDisplayPrecision=0, GltfVersion="Gltf2", InputGroups="{}", OutputGroups="{}", RelativeTolerance=0, UnitSystem=0, VersionCreated="1.13.1.0", VersionSaved="1.13.1.0"})
item_2 = ListItem(List=sort.Keys, Index=0, Wrap=True)
division = Division(A=item, B=item_2)
multiplication = Multiplication(A=division, B=Slider(1, range=0..1))
division_2 = Division(A="1", B=multiplication)
num_scalefactor = Number(multiplication)
num_scale_back_factor = Number(division_2)
scale = Scale(Geometry=srf_3, Center=Point(0, 0, 0), Factor=division_2)  # -> Geometry, Transform; disabled
scale_2 = Scale(Geometry=srf_2, Center=Point(0, 0, 0), Factor=multiplication)  # -> Geometry, Transform
srf_scaled = Surface(scale_2.Geometry)
num_scale_back_factor_2 = ClusterOutput(num_scale_back_factor)
srf_scaled_2 = ClusterOutput(srf_scaled)
